# Grasshopper definition 20180509_Circuit.gh (Grasshopper 1.0.5)
# plug-ins: Anemone, Weaverbird, GH_CPython, Kangaroo2 Components

# ---- group: INPUT
testing_size_detalization = Slider(12, range=0..20)
base_inputs = Point([<point referenced from the Rhino model> x8])
base_base_point = Point(<point referenced from the Rhino model>)
base_pattern = Curve([<curve referenced from the Rhino model> x12])
number_slider = Slider(0.97, range=0..1)
number_slider_2 = Slider(4.1, range=0.01..6, expression="-x")

# ----
sqrt = SquareRoot(Value=Tree({0}: [0.001952089231], {1}: [0.001245118284], {2}: [0.0008190385207], {3}: [0.0009074671598], {4}: [0.001132132722], {5}: [0.001578019822]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))
sqrt_2 = SquareRoot(Value=Tree({0}: [0.00509188574], {1}: [0.005848073728], {2}: [0.006299594497], {3}: [0.005643724201], {4}: [0.004935080947], {5}: [0.005139711006]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))
number_slider_3 = Slider(0.15, range=0..1)
Y = UnitY(Factor=Slider(15, range=0..100))

# ---- group: Inputs
pt = Point(<point referenced from the Rhino model>)

# ---- group: Inputs / Preparing Input Elements
vec2pt = Vector2Pt(PointA=base_base_point, PointB=pt, Unitize=False)  # -> Vector, Length
move = Move(Geometry=base_pattern, Motion=vec2pt.Vector)  # -> Geometry, Transform
move_2 = Move(Geometry=base_inputs, Motion=vec2pt.Vector)  # -> Geometry, Transform
reb = RebuildCurve(Curve=move.Geometry, Degree=2, Count=20, Tangents=False)

# ---- group: Inputs (continued)
pattern = Curve(reb)
inputnodes = Point(move_2.Geometry)
dots = DotDisplay(Point=inputnodes, Colour=ColourSwatch(SwatchColor=RGB(255, 255, 0)), Size=Slider(0.1, range=0..10))

# ---- group: Deformation Simulation
border = Curve(<curve referenced from the Rhino model>)
initial_surface = Surface(border)
base_border = Curve(<curve referenced from the Rhino model>)
testing_size_detalization_2 = Number(testing_size_detalization)
srf = Surface(base_border)

# ---- group: Deformation Simulation / Base Surface
sdivide = DivideSurface(Surface=srf, UCount=testing_size_detalization_2, VCount=testing_size_detalization_2)  # -> flatten(Points), Normals, Parameters
srfgrid = SurfaceFromPoints(Points=sdivide.Points, UCount=expr("x+1", testing_size_detalization_2), Interpolate=False)
base_srf = Surface(srfgrid)

# ---- group: Deformed Surface
mesh_uv = MeshSurface(
    Surface=initial_surface,
    UCount=testing_size_detalization,
    VCount=testing_size_detalization,
    Overhang=True,
    Equalize=False)
wbvertices = WeaverbirdsVerticesComponent(MeshClosedPolylinesGroup=mesh_uv, Weld=True)
Z = UnitZ(Factor=number_slider_2)
wbedges = WeaverbirdsMeshEdges(MeshOrPolylines=mesh_uv)
len = Length(Curve=wbedges)
disc = Discontinuity(Curve=initial_surface, Level=1)  # -> Points, Parameters
multiplication = Multiplication(A=len, B=number_slider)
anchor = Anchor(Point=disc.Points, Strength=10000)
length_line = LengthLine(Line=wbedges, Length=multiplication, Strength=10)
show = Show(G=mesh_uv)
testing_size_detalization_3 = Number(testing_size_detalization)

# ---- group: Mesh Visualization
gradient = Gradient(
    LowerLimit="0",
    UpperLimit=number_slider_3,
    Parameter=sqrt,
    stops=[0: RGB(234, 38, 0), 0.25: RGB(234, 126, 0), 0.5: RGB(254, 244, 84), 0.75: RGB(173, 203, 249), 1: RGB(75, 107, 169)])
mesh = Mesh(mesh_uv)
demesh = DeconstructMesh(Mesh=mesh)  # -> Vertices, Faces, Colours, Normals
conmesh = ConstructMesh(Vertices=demesh.Vertices, Faces=demesh.Faces, Colours=flatten(gradient))
mblur = BlurMesh(Mesh=conmesh, Iterations=1)

gradient_2 = Gradient(
    LowerLimit="0",
    UpperLimit=number_slider_3,
    Parameter=sqrt_2,
    stops=[0: RGB(234, 38, 0), 0.25: RGB(234, 126, 0), 0.5: RGB(254, 244, 84), 0.75: RGB(173, 203, 249), 1: RGB(75, 107, 169)])
mesh_2 = Mesh(mesh_uv)
demesh_2 = DeconstructMesh(Mesh=mesh_2)  # -> Vertices, Faces, Colours, Normals
conmesh_2 = ConstructMesh(Vertices=demesh_2.Vertices, Faces=demesh_2.Faces, Colours=flatten(gradient_2))
mblur_2 = BlurMesh(Mesh=conmesh_2, Iterations=1)

# ----
move_3 = Move(Geometry=conmesh, Motion=Y)  # -> Geometry, Transform

testing_size_detalization_4 = Number(testing_size_detalization_3)
addition = Addition(A=testing_size_detalization_4, B="1")
sqr = Square(Value=addition)
loop_start = LoopStart(Repeat=expr("x-1", simplify(sqr)), PushPointIndex="0")  # -> port, Counter, PushPointIndex, Readings
push_point_index = Number(loop_start.PushPointIndex)
panel = Panel(loop_start.Counter)
stop = BooleanToggle(False)
addition_2 = Addition(A=push_point_index, B="1")

# ---- group: Deformation Simulation (continued)
push_point_index_2 = Number(push_point_index)

# ---- group: Deformed Surface (continued)
item = ListItem(List=wbvertices, Index=push_point_index_2, Wrap=invert(True))
move_4 = Move(Geometry=item, Motion=Z)  # -> Geometry, Transform
ln = Line(StartPoint=item, EndPoint=move_4.Geometry)
length_line_2 = LengthLine(Line=ln, Length="0", Strength=1000)
anchor_2 = Anchor(Point=move_4.Geometry, Strength=10000)
entwine = Entwine(Branch00=show, Branch01=anchor, Branch02=length_line, Branch03=length_line_2, Branch04=anchor_2, FlattenInputs=True)
zombiesolver = ZombieSolver(GoalObjects=entwine, Threshold=1e-10, Tolerance=0.01, MaxIterations=50000)  # -> I, V, O
item_2 = ListItem(List=zombiesolver.O, Index=0, Wrap=True)

# ---- group: Deformation Simulation (continued)
mesh_3 = Mesh(item_2)

# ---- group: Deformed Surface (continued)
wbvertices_2 = WeaverbirdsVerticesComponent(MeshClosedPolylinesGroup=mesh_3, Weld=True)
srfgrid_2 = SurfaceFromPoints(Points=wbvertices_2, UCount=expr("x+1", testing_size_detalization), Interpolate=False)
deformed_srf = Surface(srfgrid_2)

# ----
mesh_4 = Mesh(mesh_3)

# ---- group: Deformation Simulation (continued)
deformed_srf_2 = Surface(deformed_srf)

# ----
merge = Merge(Data1=loop_start.Readings, Data2=deformed_srf_2)
loop_end = LoopEnd(
    port=loop_start.port,
    Exit=stop,
    PushPointIndex=addition_2,
    Readings=merge,
    TimeOutVal=0,
    pausedState=False,
    state="Constant output")  # -> Push_point_index, Readings

dam = DataDam(DataA=loop_end.Readings, BufferDelay=10000000, BufferMode=0)

# ---- group: Map Pattern to Srf
clean = CleanTree(RemoveNulls=True, RemoveInvalid=True, RemoveEmpty=invert(False), Tree=dam)  # -> simplify(Tree)
pattern_2 = Curve(pattern)
base_srf_2 = Surface(base_srf)
map_srf = MapToSurface(Curve=graft(pattern_2), Source=base_srf_2, Target=clean)  # -> simplify(Curve)
deformed_pattern = Curve(map_srf)

# ---- group: Circuit Data
disc_2 = Discontinuity(Curve=pattern_2, Level=1)  # -> simplify(Points), Parameters
flip = FlipMatrix(Data=deformed_pattern)
cset = CreateSet(List=flatten(disc_2.Points))  # -> Set, Map
deformedpatterncrvs = Curve(flip)
inputnodes_2 = Point(inputnodes)
nodes = Point(cset.Set)
cp = ClosestPoint(Point=inputnodes_2, Cloud=nodes)  # -> ClosestPoint, CPIndex, Distance
unflatten = UnflattenTree(Tree=cset.Map, Guide=disc_2.Points)
len_2 = Length(Curve=deformedpatterncrvs)

# ----
disc_3 = Discontinuity(Curve=deformedpatterncrvs, Level=1)  # -> simplify(Points), Parameters
trim = TrimTree(Tree=disc_3.Points, Depth=1)
cset_2 = CreateSet(List=trim)  # -> Set, Map
concat = Concatenate(FragmentA="{", FragmentB=Slider(0, range=0..169), FragmentC="}")
number_slider_4 = Slider(0.893, range=0..10)
branch = TreeBranch(Tree=cset_2.Set, Path=concat, MaintainPaths=True)
swatch = ColourSwatch(SwatchColor=RGB(0, 0, 0))  # disabled
tag = TextTag3D(Size=number_slider_4, Colour=swatch, Justification=7)  # disabled
points = PointList(Points=branch, Size=number_slider_4)

# ---- group: Preparing Curcuit Info
item_3 = ListItem(List=unflatten, Index=0, Wrap=True)  # -> Item, Item1
concat_2 = Concatenate(FragmentA=item_3.Item, FragmentC="to", FragmentB=item_3.Item1)  # -> flatten(Result)

# ---- group: Isolating Inputs
input_indecies = Panel(cp.CPIndex)

# ---- group: Simulation
tstat = TreeStatistics(Tree=len_2)  # -> Paths, Length, Count
subtraction = Subtraction(A=tstat.Count, B=1)
loop_start_2 = LoopStart(N=subtraction, D1="0")  # -> port, Counter, Data, Data_2
panel_2 = Panel(loop_start_2.Counter)
item_4 = ListItem(List=tstat.Paths, Index=loop_start_2.Data_2, Wrap=invert(True))
branch_2 = TreeBranch(Tree=len_2, Path=item_4, MaintainPaths=True)
gh_cpython = GH_CPython(input=input_indecies, circuit=concat_2, resistance=branch_2)  # -> simplify(output), simplify(readings); inputs input: list, circuit: list, resistance: list
# ---------- gh_cpython: Python ----------
""" 
Python Script
Created on  Wednesday May 2018 01:11:01 
@author:  Golnar 

[desc]
Description of the plugin Here
Write here any thing... 
[/desc]

ARGUMENTS:
----------
<inp> 
    _input :[required] - [type = int] - [default = None] 
    Descripe your input here 
        * bullet point.
        * bullet point
</inp>
<inp>
    Other inputs go here ...
</inp>

RETURN:
----------
    <out>
        output_ : indicate your output description here. \n refers to a new line.
    </out>

"""

# -*- coding: utf-8 -*-
# This example shows the computation of the DC biases in a resistor bridge.

####################################################################################################
import PySpice
import PySpice.Logging.Logging as Logging
from PySpice.Spice.Netlist import Circuit
from PySpice.Unit import *

####################################################################################################

#circuit_macros('resistor-bridge.m4')
logger = Logging.setup_logging()
PySpice.Spice.NgSpice.Shared.NgSpiceShared.LIBRARY_PATH="C:\\Program Files\\Spice64\\bin-dll\\ngspice{}.dll"

_output = []
_readings = []
input = _input
print(input)
print(_circuit)
for i in range(len(_input)):
    print("________________%d___________________________"%i)
    circuit = Circuit('Resistor_Bridge'+str(i))
    #for i, _input in enumerate(_input):
    
    for j, element in enumerate(_circuit):
        nodes = element.split('to')
        if (nodes[0] == '0'):   nodes[0] = '00'
        if (nodes[1] == '0'):   nodes[1] = '00'
        circuit.R(j, nodes[0], nodes[1], (_resistance[j] * 100)@u_Ω)
        print(j,">",nodes[0], nodes[1])
    if (_input[i] != 0):    vin = _input[i]
    else:                   vin = '00'
    print(">>>" + str(vin))

    for index, j in enumerate(input):
        if int(j)==0:  j ='00'
        if j==vin:  continue
        circuit.R(len(_circuit)+index+1, j, circuit.gnd, 200@u_Ω)
        print(len(_circuit)+index+1,">",j)
    circuit.V('Input', vin, circuit.gnd, 5@u_V)
    simulator = circuit.simulator(simulator = "shared", temperature=25, nominal_temperature=25)
    analysis = simulator.operating_point()
    
    sensitivity = []
    output = []
    outputValues = {key:None for key in input}
    for node in analysis.nodes.values():
        nodeIndex = int(str(node)[:].split(" ")[0])
        if nodeIndex in input: 
            output.append('{:2d}'.format(int(str(node)[:2])))
            sensitivity.append(float('{:6.4f}'.format(float(node))[:]))
            print('Node {}: {:4.1f} V'.format(str(node), float(node)))
            #if int(str(node)[0:2]) in _input:
            #    outputValues[int(str(node)[0])] = float(node)

    _readings.append(sensitivity)
    _output.append(output)
#output_ = [outputValues[i] for i in _input]
# ---------- end gh_cpython ----------
addition_3 = Addition(A=loop_start_2.Data_2, B=1)

lng = ListLength(List=input_indecies)
partition = PartitionList(List=gh_cpython.readings, Size=lng)
sort = SortList(Keys=partition)  # -> reverse(Keys), ValuesA
cull_i = CullIndex(List=sort.Keys, Indices="0", Wrap=True)

relevant_readings = Number(simplify(cull_i))
tstat_2 = TreeStatistics(Tree=relevant_readings)  # -> Paths, Length, Count
repeat = RepeatData(Data=loop_start_2.Counter, Length=tstat_2.Count)  # -> simplify(graft(Data))
dpath = DeconstructPath(Branch=tstat_2.Paths)  # -> simplify(Indices)
merge_2 = Merge(Data1=repeat, Data2=dpath)
path = ConstructPath(Indices=merge_2)
replace = ReplacePaths(Data=relevant_readings, Search=tstat_2.Paths, Replace=flatten(path))
merge_3 = Merge(Data1=loop_start_2.Data, Data2=replace)
loop_end_2 = LoopEnd(
    port=loop_start_2.port,
    Exit=Toggle(False),
    Data=merge_3,
    Data_2=addition_3,
    TimeOutVal=0,
    pausedState=False,
    state="Constant output")  # -> D0, D1

# ----
panel_3 = Panel(sort.Keys)
dam_2 = DataDam(DataA=loop_end_2.D0, BufferDelay=10000000, BufferMode=0)
trim_2 = TrimTree(Tree=dam_2, Depth=1)

flatten = FlattenTree(Tree=trim_2, Path="{0}")
gh_cpython_2 = GH_CPython(input=flatten)  # -> output; inputs input: list
# ---------- gh_cpython_2: Python ----------
# -*- coding: utf-8 -*-
""" 
Python Script
Created on  Thursday May 2018 04:11:06 
@author:  Golnar 

[desc]
Description of the plugin Here
Write here any thing... 
[/desc]

ARGUMENTS:
----------
<inp> 
    _input :[required] - [type = int] - [default = None] 
    Descripe your input here 
        * bullet point.
        * bullet point
</inp>
<inp>
    Other inputs go here ...
</inp>

RETURN:
----------
    <out>
        output_ : indicate your output description here. \n refers to a new line.
    </out>

"""

import numpy as np
import math
from matplotlib import pyplot as plt

oneD = np.array(_input)
twoD = oneD.reshape((12, 169))
print(twoD.shape)
plt.plot(twoD, linewidth=0.2)
plt.show()
# ---------- end gh_cpython_2 ----------

all_point_readings = Number(trim_2)

# ---- group: Duplicate Data
tstat_3 = TreeStatistics(Tree=all_point_readings)  # -> Paths, Length, Count
dup = DuplicateData(Data=all_point_readings, Number=tstat_3.Count, Order=True)  # -> simplify(Data)
dup_2 = DuplicateData(Data=flatten(all_point_readings), Number=tstat_3.Count, Order=True)  # -> simplify(Data)
lng_2 = ListLength(List=flatten(all_point_readings))
partition_2 = PartitionList(List=dup_2, Size=lng_2)  # -> simplify(Chunks)
partition_3 = PartitionList(List=dup, Size=graft(tstat_3.Length))  # -> simplify(Chunks)
partition_4 = PartitionList(List=partition_2, Size=graft(tstat_3.Length))  # -> simplify(Chunks)

# ---- group: Analysis
subtraction_2 = Subtraction(A=partition_3, B=partition_4)
sqr_2 = Square(Value=subtraction_2)
ma = MassAddition(Input=sqr_2)  # -> Result, PartialResults
sqrt_3 = SquareRoot(Value=ma.Result)
trim_3 = TrimTree(Tree=sqrt_3, Depth="1")
sort_2 = SortList(Keys=trim_3)  # -> Keys, ValuesA
lng_3 = ListLength(List=trim_3)
division = Division(A=lng_3, B=Slider(1, range=0..100))
subset = SubList(List=sort_2.Keys, Domain=division, Wrap=True)  # -> List, Index
sqr_3 = Square(Value=trim_3)
avr = Average(Input=sqr_3)
sqrt_4 = SquareRoot(Value=avr)

# ----
panel_4 = Panel(division)
flatten_2 = FlattenTree(Tree=sqrt_4, Path="{0}")
gh_cpython_3 = GH_CPython(input=flatten_2)  # -> output; inputs input: list
# ---------- gh_cpython_3: Python ----------
# -*- coding: utf-8 -*-
""" 
Python Script
Created on  Thursday May 2018 04:11:06 
@author:  Golnar 

[desc]
Description of the plugin Here
Write here any thing... 
[/desc]

ARGUMENTS:
----------
<inp> 
    _input :[required] - [type = int] - [default = None] 
    Descripe your input here 
        * bullet point.
        * bullet point
</inp>
<inp>
    Other inputs go here ...
</inp>

RETURN:
----------
    <out>
        output_ : indicate your output description here. \n refers to a new line.
    </out>

"""

import numpy as np
import math
from matplotlib import pyplot as plt

oneD = np.array(_input)
print(oneD.shape)
plt.plot(oneD, linewidth=0.2)
plt.show()
# ---------- end gh_cpython_3 ----------

# ---- group: Mesh Visualization
gradient_3 = Gradient(
    LowerLimit="0",
    UpperLimit=Slider(0.1, range=0..1),
    Parameter=sqrt_4,
    stops=[0: RGB(234, 38, 0), 0.25: RGB(234, 126, 0), 0.5: RGB(254, 244, 84), 0.75: RGB(173, 203, 249), 1: RGB(75, 107, 169)])
mesh_5 = Mesh(mesh_uv)
demesh_3 = DeconstructMesh(Mesh=mesh_5)  # -> Vertices, Faces, Colours, Normals
conmesh_3 = ConstructMesh(Vertices=demesh_3.Vertices, Faces=demesh_3.Faces, Colours=flatten(gradient_3))
mblur_3 = BlurMesh(Mesh=conmesh_3, Iterations=1)
